# Grasshopper definition Curve method.ghx (Grasshopper 1.0.7)
# plug-ins: Redback, Human, Bifocals

gallery = ImageGallery(CycleDelay=30, Randomize=False, UseLocalImages=True, UseRemoteImages=True)
panel = Panel("""TOWER 1
Comm
A
3
3""")
panel_2 = Panel("""BuildID
Typology
SubBuildID
Levels
F2F""")
# Create building curves
# with the following use
# attributes in Rhino
# Alternatively you can
# create the attributes in
# GH and bake it to Rhino
toggle = BooleanToggle(True)
createatts = CreateAttributes(UserDataKeys=panel_2, UserDataValues=panel, enableFullPath=False)
crv = Curve(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)
bake = BakeGeometry(Bake=toggle, Geometry=crv, Attributes=createatts, DeleteOldBakes=False, PreserveTrees=False)
# Place curves under Layer
# 01, sublayer Input Curves
dpipeline = DynamicGeometryPipeline(
    LayerFilter="Layer 01::Input Curves",
    TypeFilter="Curve",
    NameFilter="*",
    GroupByLayer=False,
    GroupByType=False,
    IncludeHidden=True,
    IncludeLocked=True,
    enableFullPath=True,
    listenToAttributes=True)

# ---- group: Cluster
tower_by_curves = TowerByCurves(geo=dpipeline)  # -> roof_2, roof_properties_2, full_mass_2, full_mass_properties_2, sub_mass_2, sub_mass_properties_2, facade_3, facade_properties_2, floorplates_2, floorplate_properties_2

# ----
list = ValueList({"RL", "Area", "Typology", "BuildID", "SubBuildID"}, selected="Area")
read = ReadJSON(Object=tower_by_curves.floorplate_properties_2, Key=list)
# Flick through value list to
# extract different floorplate
# properties
panel_3 = Panel(read)
brep = Brep(tower_by_curves.floorplates_2)
output = DataOutput(
    Roof=tower_by_curves.roof_2,
    Roof_Properties=tower_by_curves.roof_properties_2,
    Full_Mass=tower_by_curves.full_mass_2,
    Full_Mass_Properties=tower_by_curves.full_mass_properties_2,
    Sub_Mass=tower_by_curves.sub_mass_2,
    Sub_Mass_Properties=tower_by_curves.sub_mass_properties_2,
    Facade=tower_by_curves.facade_3,
    Facade_Properties=tower_by_curves.facade_properties_2,
    Floorplates=tower_by_curves.floorplates_2,
    Floorplate_Properties=tower_by_curves.floorplate_properties_2,
    Destination="C:\Users\c-nbungbrakearti\Documents\GitHub\Hackathon2018\Compiled Feaso Components\Massing Methods\Curve Method\Curve Method.ghdata")  # disabled

# ==== cluster TowerByCurves
geo = ClusterInput()
geo_2 = Geometry(geo)
panel = Panel(geo_2)
clockcrv = ClockwiseCurve(crv=geo_2)
data = Data(geo_2)
panel_2 = Panel(clockcrv)
objatts = ObjectAttributes(ObjectOrAttributes=data)  # -> Name, LayerName, LayerFullPath, Color, MaterialName, LinetypeName, GroupIndices, PlotWeight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
panel_3 = Panel("""BuildID
Typology
F2F
Levels
SubBuildID""")
json = JSON(Key=objatts.UserDataKeys, Value=objatts.UserDataValues)
read = ReadJSON(Object=json, Key=panel_3)
flip = FlipMatrix(Data=read)
read_2 = ReadJSON(Object=json, Key="Typology")  # -> flatten(Value)
read_3 = ReadJSON(Object=json, Key="SubBuildID")  # -> flatten(Value)
read_4 = ReadJSON(Object=json, Key="BuildID")  # -> flatten(Value)
branch = TreeBranch(Tree=simplify(flip), Path="3", MaintainPaths=True)  # -> graft(Branch)
branch_2 = TreeBranch(Tree=simplify(flip), Path="2", MaintainPaths=True)  # -> graft(Branch)
branch_3 = TreeBranch(Tree=flip, Path="0", MaintainPaths=True)
branch_4 = TreeBranch(Tree=flip, Path="4", MaintainPaths=True)
cset = CreateSet(List=flatten(read_4))  # -> Set, Map
addition = Addition(A=branch, B=1)
concat = Concatenate(FragmentA=branch_3, FragmentB=branch_4)
series = Series(Start=0, Step=branch_2, Count=addition)  # -> simplify(Series)
mindex = MemberIndex(Set=flatten(read_4), Member=cset.Set)  # -> Index, Count
panel_4 = Panel(concat)
python = GhPythonScript(ID=concat)  # -> StackID
# ---------- python: Python ----------
__author__ = "B-MBuckley"
__version__ = "2018.10.25"

import rhinoscriptsyntax as rs

StackID = []

for i in range(len(ID)-1):
    StackID.append(ID[0:i+1])
# ---------- end python ----------
item = ListItem(List=series, Index=0, Wrap=True)  # -> flatten(Item1), Item
panel_5 = Panel(read_3)
item_2 = ListItem(List=read_2, Index=mindex.Index, Wrap=True)  # -> simplify(Item)
item_3 = ListItem(List=read_3, Index=mindex.Index, Wrap=True)
item_4 = ListItem(List=read_4, Index=mindex.Index, Wrap=True)
mindex_2 = MemberIndex(Set=panel_4, Member=python)  # -> Index, Count
panel_6 = Panel(item.Item1)
tsort = SortText(Keys=item_3, Values=item_2, Culture=127)  # -> Keys, Values
tsort_2 = SortText(Keys=item_3, Values=item_4, Culture=127)  # -> Keys, Values
item_5 = ListItem(List=panel_6, Index=mindex_2.Index, Wrap=True)
trim = TrimTree(Tree=item_5, Depth=1)
cset_2 = CreateSet(List=tsort_2.Values)  # -> Set, Map
graft = GraftTree(Tree=tsort.Values, IncludeEmptyLists=True, IncludeNullItems=True)
graft_2 = GraftTree(Tree=tsort_2.Keys, IncludeEmptyLists=True, IncludeNullItems=True)
graft_3 = GraftTree(Tree=tsort_2.Values, IncludeEmptyLists=True, IncludeNullItems=True)
ma = MassAddition(Input=trim)  # -> Result, PartialResults
nullrep = ReplaceNulls(Items=ma.Result, Replacements="0")  # -> Items, Count
addition_2 = Addition(A=nullrep.Items, B=series)
data_2 = Data(addition_2)
pt = ConstructPoint(XCoordinate=0, YCoordinate=0, ZCoordinate=data_2)
xy = XYPlane(Origin=pt)
project = Project(Geometry=graft(data), Plane=xy)  # -> simplify(Geometry), Transform
projected_floor_curves = Geometry(project.Geometry)
first_last = FirstLast(List=projected_floor_curves)  # -> FirstValue, LastValue
first_last_2 = FirstLast(List=projected_floor_curves)  # -> FirstValue, LastValue
facade = Loft(
    Curves=[first_last.FirstValue, first_last_2.LastValue],
    Options={Adjust=False, Closed=False, LoftEnds=0, LoftSimp=0, LoftType=0, Rebuild=10, Refit=0.01})  # -> simplify(Loft)
geo_3 = Geometry(flatten(facade))
cap = CapHoles(Brep=geo_3)
item_6 = ListItem(List=cap, Index=mindex.Index, Wrap=True)
item_7 = ListItem(List=geo_3, Index=mindex.Index, Wrap=True)
tsort_3 = SortText(Keys=item_3, Values=item_6, Culture=127)  # -> Keys, Values
tsort_4 = SortText(Keys=item_3, Values=item_7, Culture=127)  # -> Keys, Values
graft_4 = GraftTree(Tree=tsort_3.Values, IncludeEmptyLists=True, IncludeNullItems=True)  # -> simplify(SubMass)
graft_5 = GraftTree(Tree=tsort_4.Values, IncludeEmptyLists=True, IncludeNullItems=True)
debrep = DeconstructBrep(Brep=graft_5)  # -> simplify(Faces), Edges, Vertices
boundary = BoundarySurfaces(Edges=project.Geometry)
floor_surfaces = Geometry(boundary)
cull_i = CullIndex(List=floor_surfaces, Indices=-1, Wrap=True)
group = Group(Objects=cull_i)  # -> flatten(Group)
item_8 = ListItem(List=group, Index=mindex.Index, Wrap=True)
tsort_5 = SortText(Keys=item_3, Values=item_8, Culture=127)  # -> Keys, Values
ungroup = Ungroup(Group=tsort_5.Values)  # -> simplify(Objects)
lng = ListLength(List=ungroup)
geo_4 = Geometry(ungroup)
dup = DuplicateData(Data=graft, Number=lng, Order=True)  # -> simplify(Data)
dup_2 = DuplicateData(Data=graft_2, Number=lng, Order=True)  # -> simplify(Data)
dup_3 = DuplicateData(Data=graft_3, Number=lng, Order=True)  # -> simplify(Data)
area = Area(Geometry=geo_4)  # -> Area, Centroid
xy_2 = XYPlane(Origin=area.Centroid)
pdecon = Deconstruct(Point=area.Centroid)  # -> XComponent, YComponent, simplify(ZComponent)
group_2 = Group(Objects=xy_2)
long = LongestList(ListA=debrep.Faces, ListB=group_2, PaddingMode=2)  # -> graft(ListA), ListB
ungroup_2 = Ungroup(Group=long.ListB)
sec = BrepPlane(Brep=long.ListA, Plane=ungroup_2)  # -> Curves, Points
shift = ShiftPaths(Data=sec.Curves, Offset=-1)
srfsplit = SurfaceSplit(Surface=long.ListA, Curves=shift)
first_last_3 = FirstLast(List=boundary)  # -> FirstValue, LastValue
data_3 = Data(simplify(graft(tsort.Values)))
data_4 = Data(simplify(graft(tsort_2.Keys)))
data_5 = Data(simplify(graft(tsort_2.Values)))
trim_2 = TrimTree(Tree=srfsplit, Depth=1)
trim_3 = TrimTree(Tree=trim_2, Depth=1)
rint = RegionIntersection(CurvesA=flatten(first_last_3.FirstValue), CurvesB=first_last_3.LastValue)
area_2 = Area(Geometry=trim_3)  # -> Area, Centroid
boundary_2 = BoundarySurfaces(Edges=rint)
pdecon_2 = Deconstruct(Point=area_2.Centroid)  # -> XComponent, YComponent, ZComponent
panel_7 = Panel("""RL
Area
Typology
SubBuildID
BuildID""")
panel_8 = Panel("""Typology
SubBuildID
BuildID""")
panel_9 = Panel("""Area
Typology
SubBuildID
BuildID""")
merge = Merge(Data1=simplify(graft(cset_2.Set)))  # -> simplify(Result)
merge_2 = Merge(Data1=simplify(graft(graft)), Data2=simplify(graft(graft_2)), Data3=simplify(graft(graft_3)))  # -> simplify(Result)
merge_3 = Merge(Data1=simplify(graft(dup)), Data2=simplify(graft(dup_2)), Data3=simplify(graft(dup_3)))  # -> simplify(Result)
panel_10 = Panel("""Typology
SubBuildID
BuildID""")
sdiff = SolidDifference(BrepsA=first_last_3.LastValue, BrepsB=flatten(boundary_2))
trim_4 = TrimTree(Tree=graft_5, Depth=1)
sort = SortList(Keys=pdecon_2.ZComponent, ValuesA=trim_3)  # -> Keys, ValuesA
lng_2 = ListLength(List=debrep.Faces)
group_3 = Group(Objects=sdiff)
partition = PartitionList(List=sort.ValuesA, Size=lng_2)
json_2 = JSON(Key=panel_8, Value=merge_3)
item_9 = ListItem(List=flatten(group_3), Index=mindex.Index, Wrap=True)
join = BrepJoin(Breps=partition)  # -> simplify(Breps), Closed
cap_2 = CapHoles(Brep=trim_4)
geo_5 = Geometry(geo_4)
area_3 = Area(Geometry=geo_5)  # -> Area, Centroid
merge_4 = Merge(
    Data1=simplify(graft(pdecon.ZComponent)),
    Data2=simplify(graft(area_3.Area)),
    Data3=simplify(graft(dup)),
    Data4=simplify(graft(dup_2)),
    Data5=simplify(graft(dup_3)))  # -> simplify(Result)
json_3 = JSON(Key=panel_7, Value=merge_4)
trim_5 = TrimTree(Tree=json_3, Depth=1)
panel_11 = Panel(trim_5)
tsort_6 = SortText(Keys=item_3, Values=item_9, Culture=127)  # -> Keys, simplify(Values)
ungroup_3 = Ungroup(Group=tsort_6.Values)
trim_6 = TrimTree(Tree=ungroup_3, Depth=1)
area_4 = Area(Geometry=trim_6)  # -> Area, Centroid
sunion = SolidUnion(Breps=cap_2)
json_4 = JSON(Key="BuildID", Value=merge)
json_5 = JSON(Key=panel_10, Value=merge_2)
sub_mass_properties = Data(json_5)
floorplate_properties = Data(trim_5)
full_mass_properties = Data(json_4)
facade_properties = Data(json_2)
full_mass = Data(simplify(graft(sunion)))
floorplates = Data(geo_5)
sub_mass = Geometry(graft_4)
facade_2 = Data(join.Breps)
ungroup_4 = Ungroup(Group=tsort_6.Values)
dup_4 = DuplicateDataMatch(SourceDataTree=ungroup_4, SecondaryData1=data_3)  # -> SourceData, SecondaryData1
dup_5 = DuplicateDataMatch(SourceDataTree=ungroup_4, SecondaryData1=data_4)  # -> SourceData, SecondaryData1
dup_6 = DuplicateDataMatch(SourceDataTree=ungroup_4, SecondaryData1=data_5)  # -> SourceData, SecondaryData1
trim_7 = TrimTree(Tree=dup_4.SecondaryData1, Depth=1)
trim_8 = TrimTree(Tree=dup_5.SecondaryData1, Depth=1)
trim_9 = TrimTree(Tree=dup_6.SecondaryData1, Depth=1)
merge_5 = Merge(
    Data1=simplify(graft(area_4.Area)),
    Data2=simplify(graft(trim_7)),
    Data3=simplify(graft(trim_8)),
    Data4=simplify(graft(trim_9)))  # -> simplify(Result)
json_6 = JSON(Key=panel_9, Value=merge_5)
trim_10 = TrimTree(Tree=json_6, Depth=1)
roof_properties = Data(trim_10)
trim_11 = TrimTree(Tree=ungroup_4, Depth=1)
roof_properties_2 = ClusterOutput(roof_properties)
full_mass_2 = ClusterOutput(full_mass)
full_mass_properties_2 = ClusterOutput(full_mass_properties)
sub_mass_2 = ClusterOutput(sub_mass)
sub_mass_properties_2 = ClusterOutput(sub_mass_properties)
facade_3 = ClusterOutput(facade_2)
floorplates_2 = ClusterOutput(floorplates)
floorplate_properties_2 = ClusterOutput(floorplate_properties)
facade_properties_2 = ClusterOutput(facade_properties)
roof = Data(trim_11)
roof_2 = ClusterOutput(roof)

# ==== cluster ClockwiseCurve: Reorders controlpoints of curve to clockwise
crv = ClusterInput()
crv_2 = Curve(crv)
cp = ControlPoints(Curve=crv_2)  # -> simplify(Points), Weights, Knots
shift = ShiftList(List=cp.Points, Shift=1, Wrap=True)
pdecon = Deconstruct(Point=cp.Points)  # -> XComponent, YComponent, ZComponent
pdecon_2 = Deconstruct(Point=shift)  # -> XComponent, YComponent, ZComponent
expression = Expression(x=pdecon.XComponent, y=pdecon_2.XComponent, z=pdecon.YComponent, u=pdecon_2.YComponent, Expression="(y-x)*(u+z)")
ma = MassAddition(Input=expression)  # -> Result, PartialResults
larger = LargerThan(FirstNumber=ma.Result, SecondNumber=0)  # -> simplify(LargerThan), OrEqualTo
dispatch = Dispatch(List=simplify(graft(crv_2)), DispatchPattern=larger.LargerThan)  # -> ListA, ListB
flip = FlipCurve(Curve=dispatch.ListB)  # -> Curve, Flag
merge = Merge(Data1=dispatch.ListA, Data2=flip.Curve)  # -> simplify(flatten(Result))
unflatten = UnflattenTree(Tree=merge, Guide=crv_2)
crv_3 = Curve(unflatten)
crv_4 = ClusterOutput(crv_3)
