# Grasshopper definition Curve method.ghx (Grasshopper 1.0.7)
# plug-ins: treesloth01, Redback, Human, Bifocals

dpipeline = DynamicGeometryPipeline(
    LayerFilter="Layer 01::Input Curves",
    TypeFilter="Curve",
    NameFilter="*",
    GroupByLayer=False,
    GroupByType=False,
    IncludeHidden=True,
    IncludeLocked=True,
    enableFullPath=True,
    listenToAttributes=True)
objatts = ObjectAttributes(ObjectOrAttributes=dpipeline)  # -> Name, LayerName, LayerFullPath, Color, MaterialName, LinetypeName, GroupIndices, PlotWeight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
panel = Panel(objatts.UserDataValues)
json = JSON(Key=objatts.UserDataKeys, Value=objatts.UserDataValues)  # -> flatten(JSON)
panel_2 = Panel(objatts.UserDataKeys)
read = ReadJSON(Object=json, Key="ZOrder")
sort = SortList(Keys=flatten(read), ValuesA=json)  # -> Keys, simplify(graft(ValuesA))
panel_3 = Panel("""Levels
F2F
ZOrder""")
read_2 = ReadJSON(Object=sort.ValuesA, Key=panel_3)
bang = ExplodeTree(Data=read_2)  # -> Branch0, Branch1, Branch2
sort_2 = SortList(Keys=flatten(read), ValuesA=dpipeline)  # -> Keys, simplify(graft(ValuesA))
read_3 = ReadJSON(Object=sort.ValuesA, Key="Parent")
tmatch = MatchText(Text="0", Pattern=read_3, Case=True)
tmatch_2 = MatchText(Text="A", Pattern=read_3, Case=True)
dispatch = Dispatch(List=sort_2.ValuesA, DispatchPattern=tmatch)  # -> ListA, ListB
dispatch_2 = Dispatch(List=bang.Branch0, DispatchPattern=tmatch)  # -> ListA, ListB
dispatch_3 = Dispatch(List=bang.Branch1, DispatchPattern=tmatch)  # -> ListA, ListB
dispatch_4 = Dispatch(List=bang.Branch0, DispatchPattern=tmatch_2)  # -> ListA, ListB
dispatch_5 = Dispatch(List=bang.Branch1, DispatchPattern=tmatch_2)  # -> ListA, ListB
dispatch_6 = Dispatch(List=sort_2.ValuesA, DispatchPattern=tmatch_2)  # -> ListA, ListB
clean = CleanTree(RemoveNulls=True, RemoveInvalid=True, RemoveEmpty=True, Tree=dispatch.ListA)
clean_2 = CleanTree(RemoveNulls=True, RemoveInvalid=True, RemoveEmpty=True, Tree=dispatch_2.ListA)
clean_3 = CleanTree(RemoveNulls=True, RemoveInvalid=True, RemoveEmpty=True, Tree=dispatch_3.ListA)
clean_4 = CleanTree(RemoveNulls=True, RemoveInvalid=True, RemoveEmpty=True, Tree=dispatch_4.ListA)
clean_5 = CleanTree(RemoveNulls=True, RemoveInvalid=True, RemoveEmpty=True, Tree=dispatch_5.ListA)
clean_6 = CleanTree(RemoveNulls=True, RemoveInvalid=True, RemoveEmpty=True, Tree=dispatch_6.ListA)
num = Number(clean_3)
num_2 = Number(clean_2)
addition = Addition(A=clean_4, B=1)
addition_2 = Addition(A=num_2, B=1)
series = Series(Start=Slider(0, range=0..100), Step=num, Count=addition_2)
first_last = FirstLast(List=series)  # -> FirstValue, LastValue
series_2 = Series(Start=first_last.LastValue, Step=clean_5, Count=addition)
pt = ConstructPoint(XCoordinate=0, YCoordinate=0, ZCoordinate=series)
pt_2 = ConstructPoint(XCoordinate=0, YCoordinate=0, ZCoordinate=series_2)
xy = XYPlane(Origin=pt)
xy_2 = XYPlane(Origin=pt_2)
project = Project(Geometry=clean, Plane=xy)  # -> Geometry, Transform
project_2 = Project(Geometry=clean_6, Plane=xy_2)  # -> Geometry, Transform
first_last_2 = FirstLast(List=project_2.Geometry)  # -> FirstValue, LastValue
first_last_3 = FirstLast(List=project_2.Geometry)  # -> FirstValue, LastValue
first_last_4 = FirstLast(List=project.Geometry)  # -> FirstValue, LastValue
first_last_5 = FirstLast(List=project.Geometry)  # -> FirstValue, LastValue
boundary = BoundarySurfaces(Edges=project_2.Geometry)
loft = Loft(
    Curves=[first_last_2.FirstValue, first_last_3.LastValue],
    Options={Adjust=False, Closed=False, LoftEnds=0, LoftSimp=0, LoftType=0, Rebuild=10, Refit=0.01})
loft_2 = Loft(
    Curves=[first_last_4.FirstValue, first_last_5.LastValue],
    Options={Adjust=False, Closed=False, LoftEnds=0, LoftSimp=0, LoftType=0, Rebuild=10, Refit=0.01})
boundary_2 = BoundarySurfaces(Edges=project.Geometry)
first_last_6 = FirstLast(List=boundary_2)  # -> FirstValue, LastValue
cull_i = CullIndex(List=boundary, Indices="-1", Wrap=True)

cull_i_2 = CullIndex(List=boundary_2, Indices="-1", Wrap=True)

first_last_7 = FirstLast(List=boundary)  # -> FirstValue, LastValue
srf = Surface(first_last_6.LastValue)
srf_2 = Surface(first_last_7.LastValue)
