# Grasshopper definition Tower by Multiple Breps.ghx (Grasshopper 1.0.7)
# Copyright: Co-de-iT
# plug-ins: Human

# ----
# GEOMETERY INPUT
panel = Panel("BREPS::Brep3")
dpipeline = DynamicGeometryPipeline(
    LayerFilter=panel,
    TypeFilter="Brep",
    NameFilter="*",
    GroupByLayer=False,
    GroupByType=False,
    IncludeHidden=True,
    IncludeLocked=True,
    enableFullPath=True,
    listenToAttributes=True)

tower_by_multiple_breps = TowerByMultipleBreps(geometry=dpipeline)  # -> usable_floorplates_2, properties_rl_2, properties_typology_2, full_mass_2, facade_3, rooftops_2

# ==== cluster TowerByMultipleBreps
geometry = ClusterInput()
geometry_2 = Data(geometry)

# ----
# SORT INTO BUILDINGS
panel = Panel("BuildID")
getuv = GetUserValue(Geometry=geometry_2, Key=panel)
cset = CreateSet(List=getuv)  # -> simplify(graft(Set)), Map
tmatch = MatchText(Text=getuv, Pattern=cset.Set, Case=True)
dispatch = Dispatch(List=geometry_2, DispatchPattern=tmatch)  # -> simplify(ListA), ListB

# ----
# GET LOWEST POINT ON EACH BREP
debrep = DeconstructBrep(Brep=dispatch.ListA)  # -> Faces, Edges, simplify(Vertices)
pdecon = Deconstruct(Point=debrep.Vertices)  # -> XComponent, YComponent, ZComponent
sort = SortList(Keys=pdecon.ZComponent, ValuesA=debrep.Vertices)  # -> reverse(Keys), reverse(ValuesA)
item = ListItem(List=sort.Keys, Index=-1, Wrap=True)  # -> simplify(Item)
utrim = UberTrim(data=item)

# ----
# CALCULATE HEIGHT OF EACH BREP
bbox = BoundingBox(Content=dispatch.ListA, Plane=PlaneXY(0, 0, 0))  # -> Box, Box_2
debox = DeconstructBox(Box=bbox.Box)  # -> Plane, X, Y, Z
dedomain = DeconstructDomain(Domain=debox.Z)  # -> Start, End
subtraction = Subtraction(A=dedomain.End, B=dedomain.Start)

getuv_2 = GetUserValue(Geometry=dispatch.ListA, Key="F2F")
getuv_3 = GetUserValue(Geometry=dispatch.ListA, Key="Typology")

# ----
# NUMBER OF FLOORS
division = Division(A=subtraction, B=getuv_2)
round = Round(Number=division)  # -> simplify(Nearest), Floor, Ceiling

# ----
# PLANE PER LEVEL
series = Series(Start=utrim, Step=getuv_2, Count=round.Nearest)
pt = ConstructPoint(XCoordinate=0, YCoordinate=0, ZCoordinate=series)  # -> simplify(Point)
xy = XYPlane(Origin=pt)

graft = GraftTree(Tree=dispatch.ListA, IncludeEmptyLists=True, IncludeNullItems=True)
# TYPOLOGY OF FLOOR
dup = DuplicateData(Data=graft(getuv_3), Number=graft(round.Nearest), Order=True)  # -> simplify(Data)

# ----
# FLOOR PLATE CRVS
sec = BrepPlane(Brep=graft, Plane=xy)  # -> Curves, Points

debrep_2 = DeconstructBrep(Brep=dispatch.ListA)  # -> Faces, Edges, Vertices

# ---- group: all floorplates
boundary = BoundarySurfaces(Edges=sec.Curves)  # -> simplify(Surfaces)

# ----
evalsrf = EvaluateSurface(Surface=reparameterize(debrep_2.Faces), Point="0.5,0.5")  # -> Point, Normal, UDirection, VDirection, Frame
utrim_2 = UberTrim(data=boundary)

# ---- group: sort by height to get tops
area = Area(Geometry=utrim_2)  # -> Area, Centroid
pdecon_2 = Deconstruct(Point=area.Centroid)  # -> XComponent, YComponent, ZComponent
sort_2 = SortList(Keys=pdecon_2.ZComponent, ValuesA=utrim_2, ValuesB=dup)  # -> reverse(Keys), reverse(ValuesA), reverse(ValuesB)
item_2 = ListItem(List=sort_2.ValuesA, Index=0, Wrap=True)

# ----
pdecon_3 = Deconstruct(Point=evalsrf.Point)  # -> XComponent, YComponent, ZComponent
sunion = SolidUnion(Breps=dispatch.ListA)
debrep_3 = DeconstructBrep(Brep=sunion)  # -> Faces, Edges, Vertices
evalsrf_2 = EvaluateSurface(Surface=reparameterize(debrep_3.Faces), Point="0.5,0.5")  # -> Point, Normal, UDirection, VDirection, Frame
devec = DeconstructVector(Vector=evalsrf_2.Normal)  # -> XComponent, YComponent, ZComponent
sort_3 = SortList(Keys=pdecon_3.ZComponent, ValuesA=debrep_2.Faces)  # -> Keys, ValuesA
panel_2 = Panel("""-1
0""")
equals = Equality(FirstNumber=devec.ZComponent, SecondNumber=Slider(1, range=0..1))  # -> Equality, Inequality

# ---- group: facade
cull_i = CullIndex(List=sort_3.ValuesA, Indices=panel_2, Wrap=True)  # -> simplify(List)

# ----
cull_i_2 = CullIndex(List=sort_2.ValuesA, Indices=0, Wrap=True)  # -> simplify(List)
geo = Geometry(cull_i)
dispatch_2 = Dispatch(List=debrep_3.Faces, DispatchPattern=equals.Equality)  # -> ListA, ListB

# ---- group: usable space above floor
area_2 = Area(Geometry=item_2)  # -> Area, Centroid
Z = UnitZ(Factor=1)
graft_2 = GraftTree(Tree=getuv_2, IncludeEmptyLists=True, IncludeNullItems=True)
line = LineSDL(Start=area_2.Centroid, Direction=Z, Length=graft_2)

# ----
graft_3 = GraftTree(Tree=dispatch.ListA, IncludeEmptyLists=True, IncludeNullItems=True)
cull_i_3 = CullIndex(List=sort_2.ValuesB, Indices=0, Wrap=True)  # -> simplify(List)
item_3 = ListItem(List=sort_2.ValuesB, Index=0, Wrap=True)
bcx = BrepCurve(Brep=graft_3, Curve=line)  # -> Curves, simplify(Points)
null = NullItem(Item=bcx.Points)  # -> NullFlags, InvalidFlags, Description
dispatch_3 = Dispatch(List=item_3, DispatchPattern=null.NullFlags)  # -> ListA, ListB
merge = Merge(Data1=dispatch_3.ListA, Data2=cull_i_3)
dispatch_4 = Dispatch(List=item_2, DispatchPattern=null.NullFlags)  # -> ListA, ListB
merge_2 = Merge(Data1=dispatch_4.ListA, Data2=cull_i_2)
area_3 = Area(Geometry=merge_2)  # -> Area, Centroid
pdecon_4 = Deconstruct(Point=area_3.Centroid)  # -> XComponent, YComponent, ZComponent
lng = ListLength(List=cull_i)
sort_4 = SortList(Keys=pdecon_4.ZComponent, ValuesA=merge_2, ValuesB=merge)  # -> Keys, ValuesA, ValuesB
pt_2 = ConstructPoint(XCoordinate=0, YCoordinate=0, ZCoordinate=sort_4.Keys)
xy_2 = XYPlane(Origin=pt_2)
group = Group(Objects=xy_2)
long = LongestList(ListA=geo, ListB=group, PaddingMode=2)  # -> ListA, ListB
ungroup = Ungroup(Group=long.ListB)
sec_2 = BrepPlane(Brep=graft(long.ListA), Plane=ungroup)  # -> Curves, Points
shift = ShiftPaths(Data=sec_2.Curves, Offset=-1)  # -> simplify(Data)
utrim_3 = UberTrim(data=sec_2.Curves)
srfsplit = SurfaceSplit(Surface=graft(long.ListA), Curves=shift)  # -> simplify(Fragments)
facade = Data(srfsplit)
utrim_4 = UberTrim(data=facade)
area_4 = Area(Geometry=utrim_4)  # -> Area, Centroid
pdecon_5 = Deconstruct(Point=area_4.Centroid)  # -> XComponent, YComponent, ZComponent
sort_5 = SortList(Keys=pdecon_5.ZComponent, ValuesA=utrim_4)  # -> Keys, ValuesA
partition = PartitionList(List=sort_5.ValuesA, Size=lng)
join = BrepJoin(Breps=partition)  # -> Breps, Closed
full_mass = Data(sunion)
rooftops = Geometry(dispatch_2.ListA)
usable_floorplates = Data(simplify(sort_4.ValuesA))
utrim_5 = UberTrim(data=join.Breps)
facade_2 = Data(utrim_5)
properties_rl = Data(simplify(sort_4.Keys))
properties_typology = Data(simplify(sort_4.ValuesB))
full_mass_2 = ClusterOutput(full_mass)
rooftops_2 = ClusterOutput(rooftops)
usable_floorplates_2 = ClusterOutput(usable_floorplates)
properties_typology_2 = ClusterOutput(properties_typology)
properties_rl_2 = ClusterOutput(properties_rl)
facade_3 = ClusterOutput(facade_2)

# ==== cluster UberTrim: Better version of Trim
data = ClusterInput()
data_2 = Data(data)
trim = TrimTree(Tree=data_2, Depth=1)
null = NullItem(Item=trim)  # -> NullFlags, InvalidFlags, Description
bool = Boolean(invert(null.NullFlags))
trim_2 = TrimTree(Tree=data_2, Depth=bool)
data_3 = Data(trim_2)
data_4 = ClusterOutput(data_3)
